# Grasshopper definition QLearning.gh (Grasshopper 0.9.76)
# plug-ins: Python Interpreter, GH_CPython

obstacle_points = Point([<point referenced from the Rhino model> x24])
number_slider = Slider(0.5, range=0..1)
pdecon = Deconstruct(Point=obstacle_points)  # -> XComponent, YComponent, ZComponent
box = CenterBox(Base=obstacle_points, X=number_slider, Y=number_slider, Z=1)

start_point = Point(<point referenced from the Rhino model>)
cir = Circle(Plane=start_point, Radius=number_slider)
pdecon_2 = Deconstruct(Point=start_point)  # -> XComponent, YComponent, ZComponent
boundary = BoundarySurfaces(Edges=cir)

number_slider_2 = Slider(9, range=0..10)
number_slider_3 = Slider(7, range=0..10)
rewards_per_target = Panel("""-20
50""")

target_point = Point([<point referenced from the Rhino model> x2])
cir_2 = Circle(Plane=target_point, Radius=number_slider)
pdecon_3 = Deconstruct(Point=target_point)  # -> XComponent, YComponent, ZComponent
tag = TextTag(Location=target_point, Text=rewards_per_target)

series = Series(Start=0, Step=1, Count=number_slider_3)
series_2 = Series(Start=0, Step=1, Count=number_slider_2)
number_slider_4 = Slider(0.4, range=0..1)
q_learning = GH_CPython(
    U=number_slider_2,
    V=number_slider_3,
    startX=pdecon_2.XComponent,
    startY=pdecon_2.YComponent,
    obstX=pdecon.XComponent,
    obstY=pdecon.YComponent,
    endX=pdecon_3.XComponent,
    endY=pdecon_3.YComponent,
    rewards=rewards_per_target)  # -> output; inputs U: list, V: list, startX: list, startY: list, obstX: list, obstY: list, endX: list, endY: list, rewards: list
#   port output: indicate your output description here. refers to a new line.
# ---------- q_learning: Python ----------
import sys
sys.path.append('C:\Users\chsjoberg\Documents\GitHub\hyper-duct')

import agent 
import environment

u = int(U)
v = int(V)

# ------------------------------------ environment 1 -----------------------------------------

gridH, gridW = u,v
start_pos = (startX,startY)
end_positions = [(endX[i],endY[i]) for i in range(len(endX))]
end_rewards = rewards
blocked_positions = [(obstX[i],obstY[i]) for i in range(len(obstX))]
#print(blocked_positions)
default_reward = -0.8

# --------------------------------------------------------------------------------------------

env = environment.Environment(gridH, gridW, end_positions, end_rewards, blocked_positions, start_pos, default_reward)

alpha = 0.2
epsilon = 0.5
discount = 0.99
action_space = env.action_space
state_space = env.state_space

a = agent.QLearningAgent(alpha, epsilon, discount, action_space, state_space)
#agent = agent.EVSarsaAgent(alpha, epsilon, discount, action_space, state_space)
#env.render(agent.qvalues)
state = env.get_state()
#print(state)

iteration = 0
maxIterations = 200000
while(iteration < maxIterations):
    iteration +=1
    possible_actions = env.get_possible_actions()
    action = a.get_action(state, possible_actions)
    next_state, reward, done = env.step(action)
    #print a.qvalues

    next_state_possible_actions = env.get_possible_actions()
    a.update(state, action, reward, next_state, next_state_possible_actions, done)
    state = next_state

    if done == True:    
        env.reset_state()
        #print a.qvalues
        #print(a.qvalues)

        state = env.get_state()
        
        continue
output = a.qvalues
# ---------- end q_learning ----------
number_slider_5 = Slider(50, range=0..50)
pt = ConstructPoint(XCoordinate=graft(series_2), YCoordinate=series, ZCoordinate=0)  # -> simplify(flatten(Point))
Y = UnitY(Factor=1)
X = UnitX(Factor=1)
panel = Panel(q_learning)
parse = PythonScript(x=q_learning)  # -> a, b, c, d
# ---------- parse: Python ----------
def chunks(l, n):
    # For item i in a range that is a length of l,
    for i in range(0, len(l), n):
        # Create an index range for l of n items:
        yield l[i:i+n]

sp = x.split(' ')

sp2 = [i.replace('[','').replace(']','').replace('\n','') for i in sp if len(i) >0]
print sp2
sp3 = [float(i) for i in sp2 if len(i) >0 and i != '\n']
sp4 = list(chunks(sp3,4))
tr = list(map(list, zip(*sp4)))
a = tr[0]
b = tr[1]
c = tr[2]
d = tr[3]
# ---------- end parse ----------
neg = Negative(Value=Slider(1, range=0..1))
rev = Reverse(Vector=Y)
rev_2 = Reverse(Vector=X)
num = Number(neg)
gradient = Gradient(
    LowerLimit=num,
    UpperLimit=number_slider_5,
    Parameter=parse.a,
    stops=[0: RGB(255, 0, 0), 0.503: RGB(255, 192, 192), 1: RGB(0, 128, 0)])
gradient_2 = Gradient(
    LowerLimit=num,
    UpperLimit=number_slider_5,
    Parameter=parse.c,
    stops=[0: RGB(255, 0, 0), 0.5: RGB(255, 192, 192), 1: RGB(0, 128, 0)])
gradient_3 = Gradient(
    LowerLimit=num,
    UpperLimit=number_slider_5,
    Parameter=parse.b,
    stops=[0: RGB(255, 0, 0), 0.5: RGB(255, 192, 192), 1: RGB(0, 128, 0)])
gradient_4 = Gradient(
    LowerLimit=num,
    UpperLimit=number_slider_5,
    Parameter=parse.d,
    stops=[0: RGB(255, 0, 0), 0.5: RGB(255, 192, 192), 1: RGB(0, 128, 0)])
line = LineSDL(Start=pt, Direction=X, Length=number_slider_4)
line_2 = LineSDL(Start=pt, Direction=Y, Length=number_slider_4)
line_3 = LineSDL(Start=pt, Direction=rev_2, Length=number_slider_4)
line_4 = LineSDL(Start=pt, Direction=rev, Length=number_slider_4)
curvepoint = PointOnCurve(line, parameter=0.5)
curvepoint_2 = PointOnCurve(line_2, parameter=0.5)
curvepoint_3 = PointOnCurve(line_4, parameter=0.5)
curvepoint_4 = PointOnCurve(line_3, parameter=0.5)
number_slider_6 = Slider(0.03, range=0..0.1)
preview = CustomPreview(Geometry=line, Shader=gradient)
preview_2 = CustomPreview(Geometry=line_3, Shader=gradient_3)
preview_3 = CustomPreview(Geometry=line_2, Shader=gradient_2)
preview_4 = CustomPreview(Geometry=line_4, Shader=gradient_4)
panel_2 = Panel(parse.a)
tag_2 = TextTag3D(Location=curvepoint_3, Text=parse.d, Size=number_slider_6, Justification=5)
tag_3 = TextTag3D(Location=curvepoint_4, Text=parse.b, Size=number_slider_6, Justification=5)
tag_4 = TextTag3D(Location=curvepoint, Text=parse.a, Size=number_slider_6, Justification=5)
tag_5 = TextTag3D(Location=curvepoint_2, Text=parse.c, Size=number_slider_6, Justification=5)
